# Grasshopper definition coexer.gh (Grasshopper 1.0.7)

merge = Merge(
    Data1=Slider(26, range=0..100),
    Data2=Slider(38, range=0..100),
    Data3=Slider(27, range=0..100),
    Data4=Slider(16, range=0..100),
    Data5=Slider(18, range=0..100))
cluster = Cluster_6(baseheight=Slider(100, range=0..100), y=merge)  # -> L, S

merge_2 = Merge(
    Data1=Slider(26, range=0..100),
    Data2=Slider(38, range=0..100),
    Data3=Slider(27, range=0..100),
    Data4=Slider(16, range=0..100),
    Data5=Slider(18, range=0..100))
cluster_2 = Cluster_5(baseheight=Slider(100, range=0..100), y=merge_2)

ベジェ曲線to花瓶 = ベジェ曲線to花瓶(
    relay=Slider(8, range=0..100),
    relay_2=Slider(75, range=0..100),
    relay_3=Slider(67, range=0..360),
    relay_6=Slider(10, range=0..100),
    relay_4=Slider(25, range=0..100),
    relay_5=Slider(39, range=0..360))  # -> S, R, C, pt_7, V, pt_8, V_2
merge_3 = Merge(Data1=ベジェ曲線to花瓶.S, Data2=ベジェ曲線to花瓶.R)

number_slider = Slider(1.2, range=0..10)
data = Data([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, "10", "30", "60", "5", "30", "80"])
brep = Brep(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)
brep_2 = Brep(cluster.L)
brep_3 = Brep(cluster_2)
item = ListItem(List=data, Index=0, Wrap=True)

# ---- group: 確認
crv = Curve(ベジェ曲線to花瓶.C)
vdis = VectorDisplay(Anchor=ベジェ曲線to花瓶.pt_7, Vector=ベジェ曲線to花瓶.V)
vdis_2 = VectorDisplay(Anchor=ベジェ曲線to花瓶.pt_8, Vector=ベジェ曲線to花瓶.V_2)

# ----
scale = Scale(Geometry=brep_2, Center=Point(0, 0, 0), Factor=Slider(1, range=0..10))  # -> Geometry, Transform
number_slider_2 = Slider(110, range=0..1000)
data_2 = Data()
vec = VectorXYZ(XComponent=number_slider_2, YComponent=number_slider_2, ZComponent=0)  # -> Vector, Length

nozzle_diameter = Slider(0.35, range=0..1)
layer_height = Slider(0.25, range=0..1)
shell_num = Slider(2, range=0..10)

move = Move(Geometry=scale.Geometry, Motion=vec.Vector)  # -> Geometry, Transform
bbox = BoundingBox(Content=move.Geometry, Plane=PlaneXY(0, 0, 0))  # -> Box, Box_2
debox = DeconstructBox(Box=bbox.Box_2)  # -> Plane, X, Y, Z
data_3 = Data([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, "10", "30", "60", "10", "30", "80"])
data_4 = Data([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, "10", "30", "60", "5", "30", "80"])
data_5 = Data([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, 10, 20, 25, 10, 15, 70])
data_6 = Data([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, "10", "30", "60", "10", "30", "92"])
data_7 = Data([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, "10", "30", "60", "5", "30", "92"])
snap_to_ground = SnapToGround(brep=move.Geometry)
panel = Panel(debox.Z)
data_8 = Data([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, "10", "30", "60", "5", "60", "92"])
entwine = Entwine(Branch00=layer_height, Branch01=nozzle_diameter, Branch02=shell_num, FlattenInputs=True)
dam = DataDam(DataA=snap_to_ground, BufferDelay=10000000, BufferMode=0)
cluster_3 = Cluster_2(brep=dam, data=entwine)  # -> crv_4, brep_3, P
crv_2 = Curve(simplify(cluster_3.crv_4))
crv_3 = Curve(simplify(crv_2))
item_2 = ListItem(List=crv_3, Index=0, Wrap=True)

# ---- group: Check
number_slider_3 = Slider(5, range=0..10)
division = Division(A=1, B=number_slider_3)
addition = Addition(A=number_slider_3, B=1)
series = Series(Start=0, Step=division, Count=addition)
number_slider_4 = Slider(0.2, range=0..1)
graph = GraphMapper(
    series,
    x0=0,
    x1=1,
    y0=0,
    y1=1,
    container_name="Bezier",
    cpx=[0, 0.597981751, 0.4143022299, 1],
    cpy=[0, 0.08425503969, 1, 1])
cluster_4 = Cluster_3(relay_2=graph, B=Slider(0.21, range=0..1), relay=item_2, D=layer_height)  # -> X, C
thresshold = Slider(62, range=0..100)
crv_4 = Curve(cluster_4.C)
checker = Checker(u=thresshold, crv=crv_4)  # -> a, L

# ----
max_length = Slider(6, range=0..10)
pitch = Slider(2, range=0..10)

merge_4 = Merge(Data1=max_length, Data2=Slider(1.5, range=0..10), Data3=pitch)
data_9 = Data(entwine)
確認 = CustomPreview(Geometry=checker.L, Material=checker.a)
entwine_2 = Entwine(Branch00=merge_4, Branch01=cluster_4.X, Branch02=item_2, Branch03=data_9, FlattenInputs=True)
baf = BAF()  # -> C, C_2
dam_2 = DataDam(DataA=entwine_2, BufferDelay=10000000, BufferMode=0)
dam_3 = DataDam(DataA=entwine_2, BufferDelay=10000000, BufferMode=0)
alt_protrusion_koch = Alt_Protrusion_Koch(data=dam_2)  # -> crv_9, a; disabled
alt_protrusion5 = Alt_Protrusion5(data=dam_2)  # -> crv_8, a
alt_protrusion_union = Alt_Protrusion5(data=dam_2)  # -> crv_8, a; disabled
bottom_layer_num = Slider(5, range=0..10)
crv_5 = Curve(alt_protrusion5.crv_8)
crv_6 = Curve(alt_protrusion5.a)

toggle_omori = BooleanToggle(False)
toggle_uzumaki = BooleanToggle(True)

data_10 = Data(entwine)
pln = Plane(cluster_3.P)
crv_7 = Curve(crv_2)
adjust_curve_end = AdjustCurveEnd(crv_2=crv_5, crv=crv_6)
entwine_3 = Entwine(
    Branch00=bottom_layer_num,
    Branch01=data_10,
    Branch02=pln,
    ToggleUzumaki=toggle_uzumaki,
    Branch04=toggle_omori,
    FlattenInputs=True)
bottom = Bottom_2(num_2=nozzle_diameter, crv=adjust_curve_end, data=entwine_3, crv_3=crv_7)
crv_8 = Curve(crv_5)
crv_9 = Curve(bottom)
merge_5 = Merge(Data1=simplify(crv_8), Data2=simplify(crv_9))
panel_2 = Panel("""新しい突起の形開発

色の割合いじり""")
clean = CleanTree(RemoveNulls=True, RemoveInvalid=True, RemoveEmpty=True, Tree=merge_5)
data_11 = Data(entwine)
crv_10 = Curve(clean)
number_slider_5 = Slider(1, range=0..1)
raft = Raft(data=data_11, crv=crv_10)
crv_11 = Curve(raft)
base_params = BassParams(
    Nozzle_Diameter=Slider(0.35, range=0..1),
    Layer_Height=Slider(0.25, range=0..1),
    Top_Solid_Layers=2,
    Bottom_Solid_Layers=2,
    Num_of_Shell=2,
    Infill_Ratio=25,
    Artifact_Shell=2,
    Temp_Nozzle=Slider(200, range=0..1000),
    Temp_Bed=Slider(0, range=0..100),
    E_multiplier=1,
    E_Speed=Slider(1500, range=0..10000),
    F_Speed=Slider(3000, range=0..10000),
    Retract=Slider(0, range=0..10))  # -> out, params; inputs E_Speed: Int32
# ---------- base_params: Python ----------
__author__ = "m0rya"

import rhinoscriptsyntax as rs
import ghpythonlib.treehelpers as th
import Rhino

layerTree = []

layerTree.append(["nozzle diameter", Nozzle_Diameter])
layerTree.append(["layer height", Layer_Height])
layerTree.append(["top solid layers", Top_Solid_Layers])
layerTree.append(["bottom solid layers", Bottom_Solid_Layers])
layerTree.append(["num of shell", Num_of_Shell])
layerTree.append(["infill pitch", Infill_Ratio])
layerTree.append(["num of artifacts shells", Artifact_Shell])
layerTree.append(["Temp_Nozzle", Temp_Nozzle])
layerTree.append(["Temp_Bed", Temp_Bed])

layerTree.append(["E_multiplier", E_multiplier])
layerTree.append(["E_Speed", E_Speed])
layerTree.append(["F_Speed", F_Speed])
layerTree.append(["Retract", Retract])

layerTree = th.list_to_tree(layerTree, source=[0])
params = layerTree
# ---------- end base_params ----------
python = GhPythonScript(x=crv_11, y=Slider(30, range=0..100))  # -> out, a; inputs x: tree, y: Int32
# ---------- python: Python ----------
__author__ = "m0rya"

import rhinoscriptsyntax as rs

import ghpythonlib.treehelpers as th

result = []

for i in range(y):
    result.append(x.Branch(i))
    
a = th.list_to_tree(result, source=[0])
# ---------- end python ----------
crv_12 = Curve(crv_10)

panel_3 = Panel("""1
2
3""")
panel_4 = Panel("""0
1
2
3""")

button = Button()
python_2 = GhPythonScript(x=crv_12, y=panel_4)  # -> out, simplify(a); inputs x: tree, y: list of Int32
# ---------- python_2: Python ----------
__author__ = "m0rya"

import rhinoscriptsyntax as rs
import ghpythonlib.treehelpers as th


result = []

for i in range(x.BranchCount):
    tmp = []
    
    for j in range(len(x.Branch(i))):
        
        if i == 0 and j == 0:
            
            ratio = [0,0,0,0]
            for k in y:
                ratio[k] = 1.0/len(y)
                
            tmp.append("M567 P0 E{0[0]}:{0[1]}:{0[2]}:{0[3]}\n".format(ratio))
            
        else:
            tmp.append(None)
    
    result.append(tmp)
                
        
    
    

a = th.list_to_tree(result, source=[0])
# ---------- end python_2 ----------
toggle = BooleanToggle(True)
python_3 = GhPythonScript(button=button, params=base_params.params, path=crv_12, path_info=python_2.a)  # -> out, a; inputs params: tree, path: tree, path_info: tree, path_converted: tree
# ---------- python_3: Python ----------
'''
#button
toggle buttonかbuttonを入れて、boolの値をいれる。
toggle buttonでやると、実行したときにエラーが出たときに、エラー情報がそのまま残るのでデバッグするときにはtoggle buttonを使う

#params
Base Paramsのコンポーネントから、出力のパラメータを入力する

#path
g-code化したいパスを入れる。
ブランチがレイヤーごとに別れている必要がある。

#path info
パスごとに付け加えたいG-codeをここで入力できる。必須ではない。
pathと同じデータ構造である必要がある。

#path_converted
pathをそのままG-Code化するのではなくて、特殊な加工を加えたG-codeを出力したいときに使う。
パスに対して加工したG-Codeをあらかじめ用意しておき、pathとそれに対応した加工されたG-codeが同じデータ構造になっているときに、
そのパスをG-codeとして出力するときに、加工したG-codeが出力される。

'''



__author__ = "m0rya"

import rhinoscriptsyntax as rs
import datetime



class GCoder:
    
    def __init__(self):
        
        print("hello")
        
    def debug(self):
        
        debugM = ''
        
        if (path_info.BranchCount is not 0):
            
            if not path_info.BranchCount == path.BranchCount:
                debugM += "path_info's data structure doesn't fit to path data structure"
        
        if (path_converted.BranchCount is not 0):
            
            if not path_converted.BranchCount == path.BranchCount:
                debugM += "path_converted's data structure doesn't fit to path data structure"
                
        debug = debugM

    def parseParams(self, params):
        self.nozzleDiameter = params.Branch(0)[1]
        self.layerHeight = params.Branch(1)[1]
        self.topSolidLayer = params.Branch(2)[1]
        self.bottomSolidLayer = params.Branch(3)[1]
        self.numOfShell = params.Branch(4)[1]
        self.pitchOfInfill = params.Branch(5)[1]
        self.numOfArtifactShell = params.Branch(6)[1]
        #self.distOfArtifact = params.Branch(7)[1]
        self.temp_bed = params.Branch(8)[1]
        self.temp_nozzle = params.Branch(7)[1]
        
        self.E_multiplier = params.Branch(9)[1]
        self.eSpeed = params.Branch(10)[1]
        self.mSpeed = params.Branch(11)[1]
        self.retractValue = params.Branch(12)[1]
        
        self.initE = "G92 E0\n"
        
        self.prePoint = [None, None]
        """
        self.eSpeed = 500
        self.mSpeed = 1000
        self.retractValue = 0.0
        """
        self.firstLayerRatio = 0.2
        
        print(path_info.BranchCount)
        self.bool_path_info = path_info.BranchCount != 0
        print(self.bool_path_info)
        self.bool_path_converted = path_converted.BranchCount != 0
        
    def calc_e(self, dist):
        filamentDia = 1.75
        
        resultE = self.E_multiplier * (dist * self.layerHeight * self.nozzleDiameter) / (3.14 * (filamentDia/2.0) * (filamentDia/2.0))
  
        return resultE
        
        
        

       
    def initFile(self):
        
        savePath = rs.SaveFileName("Export G-Code File", "G-Code Files (*.gcode) |*.gcode||")
        self.f = open(savePath, 'w')
        
        
        #write basic info
        self.f.write("; This G-Code is generated by Ryoma Takamori's Tool\n")
        
        #write comment
        
        self.f.write("; Comment\n")
        comment = rs.StringBox()
        self.f.write(": " + comment + "\n")
        self.f.write(";\n")
        
        
        
        #write date
        dateCode = "; date : {0}\n".format(datetime.datetime.today())
        self.f.write(dateCode)
        
        #write init G-Code
        
        initGCode = "; initial G-Code\n"
        initGCode += "G90\n"
        initGCode += "M82\n"
        initGCode += "G92 E0.0\n"
        initGCode += "G28 X0.0 Y0.0 Z0.0\n"
        initGCode += "G1 Z10.0 F3000.0\n"
        initGCode += "M106 P0 S255\n"
        initGCode += "M106 P1 S255\n"
        initGCode += "M190 S{0}\n".format(self.temp_bed)
        initGCode += "M109 S{0}\n".format(self.temp_nozzle)
        

        self.f.writelines(initGCode)
        self.f.write('\n')
        
        
        
    def closeFile(self):
        
        endGCode = "; End G-Code\n"
        endGCode += "M140 S0.0\n"
        endGCode += "M104 S0.0\n"
        endGCode += "M106 S0.0\n"
        #endGCode += "G28\n"
        '''z up finish'''
        endGCode += "G92 Z0\nG1 Z10 F500\n"
        endGCode += "M84\n"
        
        self.f.writelines(endGCode)
        self.f.write('\n')
        self.f.close()
        
    def crv2gcode(self, crv):
        
        gcode = []
        
        gcode.append("G92 E0\n")
        e_value = 0
        
        
        #closed or not
        closed = rs.IsCurveClosed(crv)
        
            
            
            
        if rs.IsCurveLinear(crv):
            exploded = [crv]
            
        else:
            
            if not rs.IsPolyline(crv):
                exploded = rs.ExplodeCurves(rs.ConvertCurveToPolyline(crv))
            else:
                exploded = rs.ExplodeCurves(crv)
                
            
            
        for itr, e in enumerate(exploded):
            
            crv_length = rs.CurveLength(e)
            tmp_e_value = self.calc_e(crv_length)
            
            start = rs.CurveStartPoint(e)
            end = rs.CurveEndPoint(e)
            
            #G0
            if itr == 0:
                if self.retractValue != 0:
                    gcode.append("G1 E{0}\n".format(e_value - self.retractValue))
                gcode.append("G1 X{0} Y{1} Z{2} F{3}\n".format(start.X, start.Y, start.Z, self.mSpeed))
                if self.retractValue != 0:
                    gcode.append("G1 E{0}\n".format(e_value))
        
            #G1
            if closed and itr == len(exploded)-1:
                
                if crv_length > 0.35:
                    tmpCrv = rs.ExtendCurveLength(e, 2, 1, -0.35)
                    end2 = rs.CurveEndPoint(tmpCrv)
                    tmp_e_value = self.calc_e(rs.CurveLength(tmpCrv))
                    e_value += tmp_e_value
                
                    gcode.append("G1 X{0} Y{1} E{2} F{3}\n".format(end2.X, end2.Y, e_value, self.eSpeed))
                
                    gcode.append("G1 X{0} Y{1} F{2}\n".format(end.X, end.Y, self.mSpeed))
                    
                else:
                    gcode.append("G1 X{0} Y{1} F{2}\n".format(end.X, end.Y, self.mSpeed))
            else:
            
                e_value += tmp_e_value
                gcode.append("G1 X{0} Y{1} E{2} F{3}\n".format(end.X, end.Y, e_value, self.eSpeed))
        
       
        
        
        return ''.join(gcode)
        
                
        
        
        
        
    '''
    def writePath(self, path, path_info):
        
        
        
        self.f.write("; shell\n")
        e_value = 0
        
        current_pos = rs.AddPoint(0,0,0)
        
        #each layer
        for i in range(path.BranchCount):
            self.f.write(self.initE)
            e_value = 0
            
            paths = path.Branch(i)
            params = path_info.Branch(i)
            
            
            #move Z
            self.f.write("; layer {0}\n".format(i))
            moveZ = "G0 Z{0}\n".format(self.layerHeight*0.2 + self.layerHeight*i)
            self.f.write(moveZ)
            
            
            #each path
            for itr,p in enumerate(paths):
                exploded = rs.ExplodeCurves(p)
                
                #param g-code
                if params[itr]:
                    #parsedParam = params[itr].split(',')
                    #if parsedParam[0] == "FGAM":
                    #    ratioCode = "M567 P0 E{0[1]}:{0[2]}:{0[3]}:{0[4]}\n".format(parsedParam)
                    #    self.f.write(ratioCode)
                    self.f.write(params[itr])
                    e_value = 0
                    
                        
                  
                else:
                    
                    #be changed
                    normalRatio = [0.9, 0.1, 0.0, 0.0]
                    ratioCode = "M567 P0 E{0[0]}:{0[1]}:{0[2]}:{0[3]}\n".format(normalRatio)
                    self.f.write(ratioCode)
                    
                    
                
                    #curve g-code
                    for itr2, crv in enumerate(exploded):
                        crv_length = rs.CurveLength(crv)
                        tmp_e_value = self.calc_e(crv_length)
                    
                        start = rs.CurveStartPoint(crv)
                        end = rs.CurveEndPoint(crv)
                    
                        #G0
                        if rs.Distance(current_pos, start) > 0.01:
                            retractG = "G1 E{0}\n".format(e_value-self.retractValue)
                            self.f.write(retractG)
                            
                        
                            moveG = "G0 X{0} Y{1} F{2}\n".format(start.X, start.Y, self.mSpeed)
                            self.f.write(moveG)
                            
                            retractG = "G1 E{0}\n".format(e_value)
                            self.f.write(retractG)
                            
                    
                    
                        #G1
                        e_value += tmp_e_value
                        extrudeG = "G1 X{0} Y{1} E{2} F{3}\n".format(end.X, end.Y, e_value, self.eSpeed)
                        self.f.write(extrudeG)
                        current_pos = end
                            
                            
            
    '''
    
    def writePath(self, path, path_info):
        
        #layer
        for i in range(path.BranchCount):
            
            #move Z
            self.f.write("; layer {0}\n".format(i))
            moveZ = "G1 Z{0}\n".format(self.layerHeight*0.2 + self.layerHeight*i)
            self.f.write(moveZ)
            
            
            for itr, c in enumerate(path.Branch(i)):
                
                #path_infoあり
                if (self.bool_path_info) and (path_info.Branch(i)[itr] != None):
                    self.f.write(path_info.Branch(i)[itr])

                #path_convertedあり
                if (self.bool_path_converted) and (path_converted.Branch(i)[itr] != None):
                    self.f.write(path_converted.Branch(i)[itr])

                else:
                    self.f.write(self.crv2gcode(c))

def main():

    gcoder = GCoder()

    gcoder.parseParams(params)
    gcoder.initFile()
    gcoder.writePath(path, path_info)
    gcoder.closeFile()

if button:
    main()
# ---------- end python_3 ----------
python_4 = GhPythonScript(button=button, params=base_params.params, path=crv_12, path_info=python_2.a)  # -> out, a; inputs params: tree, path: tree, path_info: tree, path_converted: tree; disabled
# ---------- python_4: Python ----------
'''
#button
toggle buttonかbuttonを入れて、boolの値をいれる。
toggle buttonでやると、実行したときにエラーが出たときに、エラー情報がそのまま残るのでデバッグするときにはtoggle buttonを使う

#params
Base Paramsのコンポーネントから、出力のパラメータを入力する

#path
g-code化したいパスを入れる。
ブランチがレイヤーごとに別れている必要がある。

#path info
パスごとに付け加えたいG-codeをここで入力できる。必須ではない。
pathと同じデータ構造である必要がある。

#path_converted
pathをそのままG-Code化するのではなくて、特殊な加工を加えたG-codeを出力したいときに使う。
パスに対して加工したG-Codeをあらかじめ用意しておき、pathとそれに対応した加工されたG-codeが同じデータ構造になっているときに、
そのパスをG-codeとして出力するときに、加工したG-codeが出力される。

'''



__author__ = "m0rya"

import rhinoscriptsyntax as rs
import datetime



class GCoder:
    
    def __init__(self):
        
        print("hello")
        
    def debug(self):
        
        debugM = ''
        
        if (path_info.BranchCount is not 0):
            
            if not path_info.BranchCount == path.BranchCount:
                debugM += "path_info's data structure doesn't fit to path data structure"
        
        if (path_converted.BranchCount is not 0):
            
            if not path_converted.BranchCount == path.BranchCount:
                debugM += "path_converted's data structure doesn't fit to path data structure"
                
        debug = debugM

    def parseParams(self, params):
        self.nozzleDiameter = params.Branch(0)[1]
        self.layerHeight = params.Branch(1)[1]
        self.topSolidLayer = params.Branch(2)[1]
        self.bottomSolidLayer = params.Branch(3)[1]
        self.numOfShell = params.Branch(4)[1]
        self.pitchOfInfill = params.Branch(5)[1]
        self.numOfArtifactShell = params.Branch(6)[1]
        #self.distOfArtifact = params.Branch(7)[1]
        self.temp_bed = params.Branch(8)[1]
        self.temp_nozzle = params.Branch(7)[1]
        
        self.E_multiplier = params.Branch(9)[1]
        self.eSpeed = params.Branch(10)[1]
        self.mSpeed = params.Branch(11)[1]
        self.retractValue = params.Branch(12)[1]
        
        self.initE = "G92 E0\n"
        
        self.prePoint = [None, None]
        """
        self.eSpeed = 500
        self.mSpeed = 1000
        self.retractValue = 0.0
        """
        self.firstLayerRatio = 0.2
        
        print(path_info.BranchCount)
        self.bool_path_info = path_info.BranchCount != 0
        print(self.bool_path_info)
        self.bool_path_converted = path_converted.BranchCount != 0
        
    def calc_e(self, dist):
        filamentDia = 1.75
        
        resultE = self.E_multiplier * (dist * self.layerHeight * self.nozzleDiameter) / (3.14 * (filamentDia/2.0) * (filamentDia/2.0))
  
        return resultE
        
        
        

       
    def initFile(self):
        
        savePath = rs.SaveFileName("Export G-Code File", "G-Code Files (*.gcode) |*.gcode||")
        self.f = open(savePath, 'w')
        
        
        #write basic info
        self.f.write("; This G-Code is generated by Ryoma Takamori's Tool\n")
        
        #write comment
        
        self.f.write("; Comment\n")
        comment = rs.StringBox()
        self.f.write(": " + comment + "\n")
        self.f.write(";\n")
        
        
        
        #write date
        dateCode = "; date : {0}\n".format(datetime.datetime.today())
        self.f.write(dateCode)
        
        #write init G-Code
        
        initGCode = "; initial G-Code\n"
        initGCode += "G90\n"
        initGCode += "M82\n"
        initGCode += "G92 E0.0\n"
        initGCode += "G28 X0.0 Y0.0 Z0.0\n"
        initGCode += "G1 Z10.0 F3000.0\n"
        initGCode += "M106 P0 S255\n"
        initGCode += "M190 S{0}\n".format(self.temp_bed)
        initGCode += "M109 S{0}\n".format(self.temp_nozzle)
        

        self.f.writelines(initGCode)
        self.f.write('\n')
        
        
        
    def closeFile(self):
        
        endGCode = "; End G-Code\n"
        endGCode += "M140 S0.0\n"
        endGCode += "M104 S0.0\n"
        endGCode += "M106 S0.0\n"
        #endGCode += "G28\n"
        '''z up finish'''
        endGCode += "G92 Z0\nG1 Z10 F500\n"
        endGCode += "M84\n"
        
        self.f.writelines(endGCode)
        self.f.write('\n')
        self.f.close()
        
    def crv2gcode(self, crv):
        
        gcode = []
        
        gcode.append("G92 E0\n")
        e_value = 0
        
        if rs.IsCurveLinear(crv):
            exploded = [crv]
            
        else:
            
            if not rs.IsPolyline(crv):
                exploded = rs.ExplodeCurves(rs.ConvertCurveToPolyline(crv))
            else:
                exploded = rs.ExplodeCurves(crv)
            
            
        for itr, e in enumerate(exploded):
            
            crv_length = rs.CurveLength(e)
            tmp_e_value = self.calc_e(crv_length)
            
            start = rs.CurveStartPoint(e)
            end = rs.CurveEndPoint(e)
            
            #G0
            if itr == 0:
                if self.retractValue != 0:
                    gcode.append("G1 E{0}\n".format(e_value - self.retractValue))
                gcode.append("G1 X{0} Y{1} F{2}\n".format(start.X, start.Y, self.mSpeed))
                if self.retractValue != 0:
                    gcode.append("G1 E{0}\n".format(e_value))
        
            #G1
            e_value += tmp_e_value
            gcode.append("G1 X{0} Y{1} E{2} F{3}\n".format(end.X, end.Y, e_value, self.eSpeed))
        
        
        
        return ''.join(gcode)
        
                
        
        
        
        
    '''
    def writePath(self, path, path_info):
        
        
        
        self.f.write("; shell\n")
        e_value = 0
        
        current_pos = rs.AddPoint(0,0,0)
        
        #each layer
        for i in range(path.BranchCount):
            self.f.write(self.initE)
            e_value = 0
            
            paths = path.Branch(i)
            params = path_info.Branch(i)
            
            
            #move Z
            self.f.write("; layer {0}\n".format(i))
            moveZ = "G0 Z{0}\n".format(self.layerHeight*0.2 + self.layerHeight*i)
            self.f.write(moveZ)
            
            
            #each path
            for itr,p in enumerate(paths):
                exploded = rs.ExplodeCurves(p)
                
                #param g-code
                if params[itr]:
                    #parsedParam = params[itr].split(',')
                    #if parsedParam[0] == "FGAM":
                    #    ratioCode = "M567 P0 E{0[1]}:{0[2]}:{0[3]}:{0[4]}\n".format(parsedParam)
                    #    self.f.write(ratioCode)
                    self.f.write(params[itr])
                    e_value = 0
                    
                        
                  
                else:
                    
                    #be changed
                    normalRatio = [0.9, 0.1, 0.0, 0.0]
                    ratioCode = "M567 P0 E{0[0]}:{0[1]}:{0[2]}:{0[3]}\n".format(normalRatio)
                    self.f.write(ratioCode)
                    
                    
                
                    #curve g-code
                    for itr2, crv in enumerate(exploded):
                        crv_length = rs.CurveLength(crv)
                        tmp_e_value = self.calc_e(crv_length)
                    
                        start = rs.CurveStartPoint(crv)
                        end = rs.CurveEndPoint(crv)
                    
                        #G0
                        if rs.Distance(current_pos, start) > 0.01:
                            retractG = "G1 E{0}\n".format(e_value-self.retractValue)
                            self.f.write(retractG)
                            
                        
                            moveG = "G0 X{0} Y{1} F{2}\n".format(start.X, start.Y, self.mSpeed)
                            self.f.write(moveG)
                            
                            retractG = "G1 E{0}\n".format(e_value)
                            self.f.write(retractG)
                            
                    
                    
                        #G1
                        e_value += tmp_e_value
                        extrudeG = "G1 X{0} Y{1} E{2} F{3}\n".format(end.X, end.Y, e_value, self.eSpeed)
                        self.f.write(extrudeG)
                        current_pos = end
                            
                            
            
    '''
    
    def writePath(self, path, path_info):
        
        #layer
        for i in range(path.BranchCount):
            
            #move Z
            self.f.write("; layer {0}\n".format(i))
            moveZ = "G1 Z{0}\n".format(self.layerHeight*0.2 + self.layerHeight*i)
            self.f.write(moveZ)
            
            
            for itr, c in enumerate(path.Branch(i)):
                
                #path_infoあり
                if (self.bool_path_info) and (path_info.Branch(i)[itr] != None):
                    self.f.write(path_info.Branch(i)[itr])

                #path_convertedあり
                if (self.bool_path_converted) and (path_converted.Branch(i)[itr] != None):
                    self.f.write(path_converted.Branch(i)[itr])

                else:
                    self.f.write(self.crv2gcode(c))

def main():

    gcoder = GCoder()

    gcoder.parseParams(params)
    gcoder.initFile()
    gcoder.writePath(path, path_info)
    gcoder.closeFile()

if button:
    main()
# ---------- end python_4 ----------
panel_5 = Panel(python_3.out)

dam_4 = DataDam(DataA=crv_8, BufferDelay=10000000, BufferMode=0)
flatten = FlattenTree(Tree=dam_4, Path="{0}")
cull = CullPattern(List=flatten, CullPattern=[True, False, False])
loft = Loft(Curves=cull, Options={Adjust=False, Closed=False, LoftEnds=0, LoftSimp=0, LoftType=0, Rebuild=10, Refit=0.01})
mesh = Mesh(loft)
weld = WeldMesh(Mesh=mesh, Angle=3.141592654)
demesh = DeconstructMesh(Mesh=weld)  # -> Vertices, Faces, Colours, Normals
pdecon = Deconstruct(Point=demesh.Normals)  # -> XComponent, YComponent, ZComponent
pt = ConstructPoint(XCoordinate=pdecon.XComponent, YCoordinate=pdecon.YComponent, ZCoordinate=0)
pt_2 = Point(Point(0, 0, 0))
pt_3 = Point(Point(1, 0, 0))
vec2pt = Vector2Pt(PointA=pt_2, PointB=pt, Unitize=False)  # -> Vector, Length
pi = Pi(Factor="2")
xy = XYPlane(Origin=Point(0, 0, 0))
vec_2 = Vector(pt_3)
angle = Angle(VectorA=vec2pt.Vector, VectorB=vec_2, Plane=xy)  # -> Angle, Reflex
gradient = Gradient(
    LowerLimit=0,
    UpperLimit=pi,
    Parameter=angle.Angle,
    stops=[0: RGB(89, 142, 179), 0.328: RGB(177, 88, 117), 0.662: RGB(177, 176, 88), 1: RGB(89, 141, 178)])
conmesh = ConstructMesh(Vertices=demesh.Vertices, Faces=demesh.Faces, Colours=gradient)

# ==== cluster Cluster_2
brep = ClusterInput()
data = ClusterInput()
brep_2 = Brep(brep)
data_2 = Data(data)
bbox = BoundingBox(Content=brep_2, Plane=PlaneXY(0, 0, 0))  # -> Box, Box_2
bang = ExplodeTree(Data=data_2)  # -> Branch0, Branch1, Branch2
debox = DeconstructBox(Box=bbox.Box)  # -> Plane, X, Y, Z
num = Number(bang.Branch0)
num_2 = Number(bang.Branch1)
dedomain = DeconstructDomain(Domain=debox.Z)  # -> Start, End
num_3 = Number(bang.Branch2)
brep_3 = ClusterOutput(brep_2)
cap = CapHoles(Brep=brep_2)
division = Division(A=dedomain.End, B=num)
series = Series(Start=0, Step=num, Count=division)
vec = VectorXYZ(XComponent=0, YComponent=0, ZComponent=series)  # -> Vector, Length
xy = XYPlane(Origin=vec.Vector)
sec = BrepPlane(Brep=cap, Plane=xy)  # -> Curves, Points
P = ClusterOutput(xy)
crv = Curve(simplify(sec.Curves))
cluster = Cluster(relay=crv, B=Slider(2, range=0..10), relay_2=num_2, num=Slider(0.8, range=0..1), relay_3=num_3)
pln = Plane(graft(xy))
crv_2 = Curve(simplify(cluster))
project = Project(Geometry=crv_2, Plane=pln)  # -> Geometry, Transform
crv_3 = Curve(project.Geometry)
crv_4 = ClusterOutput(crv_3)

# ==== cluster SnapToGround
brep = ClusterInput()
brep_2 = Brep(brep)
bbox = BoundingBox(Content=brep_2, Plane=PlaneXY(0, 0, 0))  # -> Box, Box_2
debox = DeconstructBox(Box=bbox.Box)  # -> Plane, X, Y, Z
dedomain = DeconstructDomain(Domain=debox.Z)  # -> Start, End
neg = Negative(Value=dedomain.Start)
Z = UnitZ(Factor=neg)
move = Move(Geometry=brep_2, Motion=Z)  # -> Geometry, Transform
G = ClusterOutput(move.Geometry)

# ==== cluster Cluster_3
relay = ClusterInput()
flatten = FlattenTree(Tree=relay, Path="{0}")
len = Length(Curve=relay)
relay_2 = ClusterInput()
lng = ListLength(List=flatten)
division = Division(A=len, B=3.141592654)
subtraction = Subtraction(A=lng, B=1)
division_2 = Division(A=division, B=2)
multiplication = Multiplication(A=relay_2, B=subtraction)
round = Round(Number=multiplication)  # -> Nearest, Floor, Ceiling
area = Area(Geometry=relay)  # -> Area, Centroid
branch = TreeBranch(Tree=division_2, Path=round.Nearest, MaintainPaths=True)  # -> flatten(Branch)
dispatch = Dispatch(List=branch, DispatchPattern=[True, False])  # -> ListA, graft(ListB)
pdecon = Deconstruct(Point=area.Centroid)  # -> XComponent, YComponent, ZComponent
branch_2 = TreeBranch(Tree=pdecon.ZComponent, Path=round.Nearest, MaintainPaths=True)  # -> flatten(Branch)
neg = Negative(Value=dispatch.ListA)  # -> graft(Result)
B = ClusterInput()
merge = Merge(Data1=neg, Data2=dispatch.ListB)  # -> flatten(Result)
multiplication_2 = Multiplication(A=merge, B=B)
pt = ConstructPoint(XCoordinate=multiplication_2, YCoordinate=0, ZCoordinate=branch_2)
intcrv = Interpolate(Vertices=pt, Degree=3, Periodic=False, KnotStyle=1)  # -> Curve, Length, Domain
D = ClusterInput()
contour = Contour(Curve=intcrv.Curve, Point=Point(0, 0, 0), Direction=Vector(0, 0, 1), Distance=D)  # -> simplify(flatten(Contours)), Parameters
end = EndPoints(Curve=intcrv.Curve)  # -> Start, End
C = ClusterOutput(intcrv.Curve)
merge_2 = Merge(Data1=contour.Contours, Data2=end.End)
pdecon_2 = Deconstruct(Point=merge_2)  # -> XComponent, YComponent, ZComponent
X = ClusterOutput(pdecon_2.XComponent)

# ==== cluster ベジェ曲線to花瓶
relay = ClusterInput()
relay_2 = ClusterInput()
relay_3 = ClusterInput()
relay_4 = ClusterInput()
relay_5 = ClusterInput()
relay_6 = ClusterInput()
vec = VectorXYZ(XComponent=relay_2, YComponent=0, ZComponent=0)  # -> Vector, Length
rad = Radians(Degrees=relay_3)
rad_2 = Radians(Degrees=relay_5)
vec_2 = VectorXYZ(XComponent=relay_4, YComponent=0, ZComponent=0)  # -> Vector, Length
pt = Point(Point(0, 1, 0))
neg = Negative(Value=rad_2)
pt_2 = Point(Point(0, 1, 0))
vrot = Rotate(Vector=vec.Vector, Axis=pt, Angle=rad)
pt_3 = ConstructPoint(XCoordinate=relay_6, YCoordinate=0, ZCoordinate=0)
vrot_2 = Rotate(Vector=vec_2.Vector, Axis=pt_2, Angle=neg)
pt_4 = ConstructPoint(XCoordinate=relay, YCoordinate=0, ZCoordinate=Slider(100, range=0..100))
bzspan = BezierSpan(StartPoint=pt_3, StartTangent=vrot_2, EndPoint=pt_4, EndTangent=vrot)  # -> Curve, Length, Domain
pt_5 = Point(Point(0, 0, 0))
pt_6 = Point(Point(0, 0, 1))
ln = Line(StartPoint=pt_5, EndPoint=pt_6)
merge = Merge(Data1=relay_6, Data2=relay_4, Data3=relay_5, Data4=relay, Data5=relay_2, Data6=relay_3)
revsrf = Revolution(Curve=bzspan.Curve, Axis=ln, Domain=Domain(0, 6.283185307))
C = ClusterOutput(bzspan.Curve)
pt_7 = ClusterOutput(pt_4)
V = ClusterOutput(vrot)
pt_8 = ClusterOutput(pt_3)
V_2 = ClusterOutput(vrot_2)
vdis = VectorDisplay(Anchor=pt_3, Vector=vrot_2)
vdis_2 = VectorDisplay(Anchor=pt_4, Vector=vrot)
S = ClusterOutput(revsrf)
R = ClusterOutput(merge)

# ==== cluster BAF
crv = ClusterInput()
crv_2 = Curve(flatten(crv))
series = Series(Start=0, Step=1, Count=Slider(40, range=0..100))
item = ListItem(List=crv_2, Index=series, Wrap=True)
crv_3 = Curve(flatten(crv))
len = Length(Curve=crv_3)
dom = ConstructDomain(DomainStart=0, DomainEnd=len)
crvdom = CurveDomain(Curve=crv_3, Domain=dom)  # -> Curve, Domain
crv_4 = Curve(crvdom.Curve)
len_2 = Length(Curve=crv_4)
sort = SortList(Keys=len_2, ValuesA=crv_4)  # -> Keys, ValuesA
item_2 = ListItem(List=sort.ValuesA, Index=-1, Wrap=True)
B = ClusterInput()
number_slider = Slider(0.1, range=0..0.1)
len_3 = Length(Curve=item_2)
division = Division(A=len_3, B=B)
area = Area(Geometry=item_2)  # -> Area, Centroid
python = GhPythonScript(x=division)  # -> out, a
# ---------- python: Python ----------
__author__ = "m0rya"

import rhinoscriptsyntax as rs

a = int(x)

if a%2 != 0:
    a = a+1
# ---------- end python ----------
num = Number(Slider(0.1, range=0.1..5))
divide = DivideCurve(Curve=crv_4, Count=python.a, Kinks=False)  # -> Points, Tangents, simplify(Parameters)
python_2 = GhPythonScript(x=divide.Parameters)  # -> out, a; inputs x: tree
# ---------- python_2: Python ----------
__author__ = "m0rya"

import rhinoscriptsyntax as rs

a = x.BranchCount
# ---------- end python_2 ----------
series_2 = Series(Start=0, Step=1, Count=python_2.a)
X = UnitX(Factor=series_2)
multiplication = Multiplication(A=X, B=Slider(0.1, range=0..1))
perlin = PerlinNoise(Values=multiplication, Time=0, Scale=Slider(0.04, range=0..3))
sin = Sine()
multiplication_2 = Multiplication(A=perlin, B=Slider(40, range=0..100))
shatter = Shatter(Curve=graft(crv_4), Parameters=divide.Parameters)
sort_2 = SortList(Keys=multiplication_2)  # -> Keys, ValuesA
xy = XYPlane(Origin=Point(0, 0, 0))
pt = Point(area.Centroid)
item_3 = ListItem(List=sort_2.Keys, Index=0, Wrap=True)
number_slider_2 = Slider(3, range=0..10)
neg = Negative(Value=item_3)
addition = Addition(A=multiplication_2, B=neg)
python_3 = GhPythonScript(x=divide.Parameters, y=num, z=len, u=addition)  # -> out, graft(a); inputs x: tree, z: list, u: list
# ---------- python_3: Python ----------
__author__ = "m0rya"

import rhinoscriptsyntax as rs
import ghpythonlib.treehelpers as th

result = []

num = x.BranchCount
adder = []

for i in range(num):
    adder.append(i*y)

adder = u
for i in range(x.BranchCount):
    
    tmp = []
    for j in range(len(x.Branch(i))):
        
        tmpNum = x.Branch(i)[j] + adder[i]
        
        if tmpNum > z[i]:
            tmp.append(tmpNum - z[i])
        else:
            tmp.append(tmpNum)
        

            
    result.append(tmp)
            
        
a = th.list_to_tree(result, source=[0])
# ---------- end python_3 ----------
trim = TrimTree(Tree=python_3.a, Depth=1)  # -> simplify(Tree)
eval = EvaluateCurve(Curve=graft(crv_4), Parameter=trim)  # -> Point, Tangent, Angle
pt_2 = Point(multiplication)
project = Project(Geometry=pt, Plane=xy)  # -> Geometry, Transform
shift = ShiftList(List=eval.Point, Shift=1, Wrap=True)
vec = VectorXYZ(XComponent=multiplication, YComponent=addition, ZComponent=0)  # -> Vector, Length
neg_2 = Negative(Value=number_slider_2)
perlin_2 = PerlinNoise(Values=pt_2, Time=Slider(1.245, range=0..10), Scale=Slider(0.1, range=0..0.1))
ln = Line(StartPoint=eval.Point, EndPoint=shift)  # -> simplify(Line)
pt_3 = Point(vec.Vector)
dom_2 = ConstructDomain(DomainStart=neg_2, DomainEnd=number_slider_2)
crv_5 = Curve(ln)
end = EndPoints(Curve=crv_5)  # -> Start, End
addition_2 = Addition(A=end.Start, B=end.End)
division_2 = Division(A=addition_2, B=2)  # -> simplify(Result)
project_2 = Project(Geometry=division_2, Plane=xy)  # -> Geometry, Transform
subtraction = Subtraction(A=project_2.Geometry, B=project.Geometry)
unit = UnitVector(Vector=subtraction)
python_4 = GhPythonScript(x=unit)  # -> out, a; inputs x: tree; same code as python_2
bnd = Bounds(Numbers=perlin_2)
A = ClusterInput()
crv_6 = Curve(simplify(graft(crv_4)))
remap = RemapNumbers(Value=perlin_2, Source=bnd, Target=dom_2)  # -> simplify(graft(Mapped)), simplify(graft(Clipped))
pt_4 = Point(simplify(graft(end.Start)))
lng = ListLength(List=perlin_2)
pt_5 = Point(simplify(graft(end.End)))
merge = Merge(Data1=pt_4, Data2=pt_5)
trim_2 = TrimTree(Tree=merge, Depth=1)
multiplication_3 = Multiplication(A=Slider(180, range=0..1000), B=Slider(4, range=0..10))
division_3 = Division(A=multiplication_3, B=lng)
merge_2 = Merge(Data1=pt_4, Data2=graft(division_2), Data3=pt_5)
crv_cp = CurveClosestPoint(Point=trim_2, Curve=crv_6)  # -> Point, Parameter, Distance
series_3 = Series(Start=0, Step=division_3, Count=lng)
series_4 = Series(Start=0, Step=Slider(0.25, range=0..1), Count=lng)
pline = PolyLine(Vertices=merge_2, Closed=False)
intcrv = Interpolate(Vertices=merge_2, Degree=3, Periodic=False, KnotStyle=1)  # -> Curve, Length, Domain; disabled
number_slider_3 = Slider(0.25, range=0..1)  # disabled
rad = Radians(Degrees=series_3)
eval_2 = EvaluateCurve(Curve=crv_6, Parameter=crv_cp.Parameter)  # -> Point, Tangent, Angle
trim_3 = TrimTree(Tree=pline, Depth=1)
crv_7 = Curve(trim_3)  # disabled
pi = Pi(Factor=Slider(0.5, range=0..1))
sin_2 = Sine(Value=rad)
partition = PartitionList(List=eval_2.Tangent, Size=2)
neg_3 = Negative(Value=pi)
cluster = Cluster_4(B=number_slider_3, crv=crv_7)  # disabled
rotate = Rotate(Geometry=partition, Angle=neg_3, Plane=PlaneXY(0, 0, 0))  # -> Geometry, Transform
multiplication_4 = Multiplication(A=sin_2, B=Slider(4, range=0..10))
graft = GraftTree(Tree=multiplication_4, IncludeEmptyLists=True, IncludeNullItems=True)  # -> simplify(Tree)
multiplication_5 = Multiplication(A=graft, B=unit)  # -> simplify(Result)
addition_3 = Addition(A=multiplication_5, B=division_2)  # -> simplify(graft(Result))
crv_8 = Curve(cluster)  # disabled
vec_2 = Vector(graft(unit))
pt_6 = Point(merge_2)
data = Data(remap.Mapped)
vec_3 = Vector(rotate.Geometry)
num_2 = Number(python.a)
join = JoinCurves(Curves=trim_3, Preserve=False)
vec_4 = VectorXYZ(XComponent=series_4, YComponent=flatten(multiplication_4), ZComponent=0)  # -> Vector, Length
C = ClusterOutput(join)
python_5 = GhPythonScript(params=data, pnts=pt_6, vec1=vec_3, vec2=vec_2, num=num_2)  # -> out, a; inputs params: tree, pnts: tree of Point3d, vec1: tree of Point3d, vec2: tree of Point3d
# ---------- python_5: Python ----------
__author__ = "m0rya"

import rhinoscriptsyntax as rs
import ghpythonlib.treehelpers as th


result = []
for i in range(params.BranchCount):
    
    tmp = []
    for j in range(int(num)):
        
        
        
        pnt = pnts.Branch(i*num + j) # start mid end
        vecA = vec1.Branch(i*num + j) # start end
        vecB = vec2.Branch(i*num + j) # mid
        
        
        if params.Branch(i)[0] > 0:
            #move start end
            
            pnt[0] = pnt[0] + vecA[0] * -1* params.Branch(i)[0]
            pnt[2] = pnt[2] + vecA[1] * -1* params.Branch(i)[0]
            
            
        else:
            #move mid
            pnt[1] = pnt[1] + vecB[0] * params.Branch(i)[0]
            
        
        tmp.append(pnt)
        
    result.append(tmp)
        
a = th.list_to_tree(result, source=[0,0])
# ---------- end python_5 ----------
crv_9 = Curve(crv_3)
pt_7 = Point(vec_4.Vector)
pline_2 = PolyLine(Vertices=python_5.a, Closed=False)
panel = Panel(python_5.out)
trim_4 = TrimTree(Tree=pline_2, Depth=1)  # -> simplify(Tree)
join_2 = JoinCurves(Curves=trim_4, Preserve=False)
item_4 = ListItem(List=flatten(join_2), Index=Slider(0, range=0..170), Wrap=True)
C_2 = ClusterOutput(join_2)

# ==== cluster Cluster_5
baseheight = ClusterInput()
y = ClusterInput()
python = GhPythonScript(baseHeight=baseheight, y=y)  # -> out, a; inputs y: list
# ---------- python: Python ----------
__author__ = "m0rya"

import rhinoscriptsyntax as rs


result = []
golden = 1.618


#bottom
bottom = rs.AddPoint((y[0],0,0))
result.append(bottom)


#bottom-mid

mid = rs.AddPoint((y[1],0,baseHeight/(1+golden)*golden))
result.append(mid)

#mid
result.append(rs.AddPoint((y[2],0,baseHeight)))


#mid-top


result.append(rs.AddPoint((y[3],0, baseHeight + baseHeight/golden/(1+golden)*golden)))


#top
top = rs.AddPoint((y[4],0,baseHeight/golden+baseHeight))
result.append(top)


a = result
# ---------- end python ----------
Z = UnitZ(Factor=1)
vec = VectorXYZ(XComponent=0, YComponent=0, ZComponent=0)  # -> Vector, Length
intcrv = Interpolate(Vertices=python.a, Degree=3, Periodic=False, KnotStyle=1)  # -> Curve, Length, Domain
line = LineSDL(Start=vec.Vector, Direction=Z, Length=1)
revsrf = Revolution(Curve=intcrv.Curve, Axis=line, Domain=Domain(0, 6.283185307))
S = ClusterOutput(revsrf)

# ==== cluster Checker
crv = ClusterInput()
crv_2 = Curve(crv)
len = Length(Curve=crv_2)
int = Integer(len)
divide = DivideCurve(Curve=crv_2, Count=int, Kinks=False)  # -> Points, Tangents, Parameters
eval = EvaluateCurve(Curve=crv_2, Parameter=divide.Parameters)  # -> Point, Tangent, Angle
xz = XZPlane(Origin=Point(0, 0, 0))
Z = UnitZ(Factor=1)
shift = ShiftList(List=divide.Points, Shift=1, Wrap=False)
angle = Angle(VectorA=Z, VectorB=eval.Tangent, Plane=xz)  # -> Angle, Reflex
vdis = VectorDisplay(Anchor=eval.Point, Vector=eval.Tangent)
deg = Degrees(Radians=angle.Angle)  # -> flatten(Degrees)
short = ShortestList(ListA=divide.Points, ListB=shift, TrimMode=2)  # -> ListA, ListB
python = GhPythonScript(x=deg)  # -> out, a
# ---------- python: Python ----------
__author__ = "m0rya"

import rhinoscriptsyntax as rs

if x > 180:
    a = 360-x
else:
    a = x
# ---------- end python ----------
u = ClusterInput()
cull_i = CullIndex(List=python.a, Indices=-1, Wrap=True)
ln = Line(StartPoint=short.ListA, EndPoint=short.ListB)
python_2 = GhPythonScript(x=cull_i, y=ColourSwatch(SwatchColor=RGB(255, 0, 255)), z=ColourSwatch(SwatchColor=RGB(0, 0, 255)), u=u)  # -> out, a
# ---------- python_2: Python ----------
__author__ = "m0rya"

import rhinoscriptsyntax as rs


if x > u:
    a = y
else:
    a = z
# ---------- end python_2 ----------
a = ClusterOutput(python_2.a)
L = ClusterOutput(ln)

# ==== cluster Raft
crv = ClusterInput()
data = ClusterInput()
crv_2 = Curve(crv)
data_2 = Data(data)
branch = TreeBranch(Tree=crv_2, Path="{0}", MaintainPaths=True)
brec = BoundingRectangle(Geometry=branch, Plane=PlaneXY(0, 0, 0), Axis=0, Slide=0, Union=True)
cp = ControlPoints(Curve=brec)  # -> Points, Weights, Knots
area = Area(Geometry=brec)  # -> Area, Centroid
dist = Distance(PointA=cp.Points, PointB=area.Centroid)
sort = SortList(Keys=dist)  # -> Keys, ValuesA
item = ListItem(List=sort.Keys, Index=-1, Wrap=True)
bang = ExplodeTree(Data=data_2)  # -> Branch0, Branch1
cir = Circle(Plane=area.Centroid, Radius=item)
series = Series(Start=0, Step=Slider(0.2, range=0..1), Count=Slider(3, range=0..10))
Z = UnitZ(Factor=series)
move = Move(Geometry=cir, Motion=Z)  # -> Geometry, Transform
item_2 = ListItem(List=move.Geometry, Index=0, Wrap=True)
brec_2 = BoundingRectangle(Geometry=item_2, Plane=PlaneXY(0, 0, 0), Axis=0, Slide=0, Union=True)
cp_2 = ControlPoints(Curve=brec_2)  # -> Points, Weights, Knots
item_3 = ListItem(List=cp_2.Points, Index=[0, 2], Wrap=True)
item_4 = ListItem(List=cp_2.Points, Index=3, Wrap=True)
item_5 = ListItem(List=cp_2.Points, Index=1, Wrap=True)
pline = PolyLine(Vertices=item_3, Closed=False)
midpt = CurveMiddle(Curve=pline)
subtraction = Subtraction(A=item_5, B=midpt)
subtraction_2 = Subtraction(A=item_4, B=item_5)
move_2 = Move(Geometry=pline, Motion=subtraction)  # -> Geometry, Transform
bang_2 = ExplodeTree(Data=data_2)  # -> Branch0, Branch1
vlen = VectorLength(Vector=subtraction_2)
division = Division(A=vlen, B=bang_2.Branch1)
int = Integer(division)
unit = UnitVector(Vector=subtraction_2)
series_2 = Series(Start=0, Step=bang_2.Branch1, Count=int)
multiplication = Multiplication(A=series_2, B=unit)
move_3 = Move(Geometry=move_2.Geometry, Motion=multiplication)  # -> Geometry, Transform
pt = Point(area.Centroid)
crv_3 = Curve(move_3.Geometry)
xy = XYPlane(Origin=pt)
crv_4 = Curve(move.Geometry)
cull = CullPattern(List=crv_3, CullPattern=[False, False, False, False, True])
rotate = Rotate(Geometry=crv_3, Angle=1.570796327, Plane=xy)  # -> Geometry, Transform
neg = Negative(Value=bang_2.Branch1)
vec = Vector(graft(Z))
entwine = Entwine(Branch00=cull, Branch01=rotate.Geometry, Branch02=crv_3, FlattenInputs=True)
number_slider = Slider(0.5, range=0..1)
number_slider_2 = Slider(1.1, range=0..10)
number_slider_3 = Slider(0.6, range=0..1)
number_slider_4 = Slider(0.39, range=0..1)
number_slider_5 = Slider(0.8, range=0..1)
number_slider_6 = Slider(0.9, range=0..1)
number_slider_7 = Slider(0.7, range=0..1)
number_slider_8 = Slider(1, range=0..1)
offset = OffsetCurve(Curve=crv_4, Distance=neg, Plane=PlaneXY(0, 0, 0), Corners=1)  # -> simplify(Curve)
move_4 = Move(Geometry=entwine, Motion=vec)  # -> Geometry, Transform
item_6 = ListItem(List=series, Index=-1, Wrap=True)
crv_5 = Curve(crv_2)
trim = TrimWithRegion(Curve=move_4.Geometry, Region=crv_4)  # -> Inside, Outside
merge = Merge(Data1=simplify(graft(crv_4)), Data2=offset)
addition = Addition(A=item_6, B=Slider(0.55, range=0..1))
trim_2 = TrimTree(Tree=trim.Inside, Depth=1)
Z_2 = UnitZ(Factor=addition)
crv_6 = Curve(simplify(trim_2))
dispatch = Dispatch(List=crv_6, DispatchPattern=[True, False])  # -> ListA, ListB
move_5 = Move(Geometry=crv_5, Motion=Z_2)  # -> Geometry, Transform
flip = FlipCurve(Curve=dispatch.ListB)  # -> Curve, Flag
crv_7 = Curve(merge)
weave = Weave(Pattern=[0, 1], Stream0=dispatch.ListA, Stream1=flip.Curve, NullGaps=False)
merge_2 = Merge(Data1=crv_7, Data2=weave)
crv_8 = Curve(simplify(move_5.Geometry))
crv_9 = Curve(merge_2)
python = GhPythonScript(x=crv_9, y=crv_8)  # -> out, a; inputs x: tree, y: tree
# ---------- python: Python ----------
__author__ = "m0rya"

import rhinoscriptsyntax as rs
import ghpythonlib.treehelpers as th

result = []

for i in range(x.BranchCount):
    result.append(x.Branch(i))
    
for i in range(y.BranchCount):
    result.append(y.Branch(i))



a = th.list_to_tree(result, source=[0])
# ---------- end python ----------
a = ClusterOutput(python.a)

# ==== cluster Cluster_6
baseheight = ClusterInput()
y = ClusterInput()
python = GhPythonScript(baseHeight=baseheight, y=y)  # -> out, a; inputs y: list; same code as python
Z = UnitZ(Factor=1)
vec = VectorXYZ(XComponent=0, YComponent=0, ZComponent=0)  # -> Vector, Length
intcrv = Interpolate(Vertices=python.a, Degree=3, Periodic=False, KnotStyle=1)  # -> Curve, Length, Domain
line = LineSDL(Start=vec.Vector, Direction=Z, Length=1)
revsrf = Revolution(Curve=intcrv.Curve, Axis=line, Domain=Domain(0, 6.283185307))
number_slider = Slider(30, range=0..100)
S = ClusterOutput(revsrf)
crv = Curve(intcrv.Curve)
division = Division(A="360", B=number_slider)
series = Series(Start=0, Step=division, Count=number_slider)
rad = Radians(Degrees=series)
rotate = Rotate(Geometry=crv, Angle=rad, Plane=PlaneXY(0, 0, 0))  # -> Geometry, Transform
divide = DivideCurve(Curve=rotate.Geometry, Count=Slider(30, range=0..100), Kinks=False)  # -> Points, Tangents, Parameters
project = Project(Geometry=divide.Points, Plane=PlaneXY(0, 0, 0))  # -> Geometry, Transform
simplex = SimplexNoise(Values=divide.Points, Time=0, Scale=Slider(0.035, range=0..0.1))
unit = UnitVector(Vector=project.Geometry)
multiplication = Multiplication(A=simplex, B=Slider(5, range=0..10))
multiplication_2 = Multiplication(A=unit, B=multiplication)
addition = Addition(A=divide.Points, B=multiplication_2)
intcrv_2 = Interpolate(Vertices=addition, Degree=3, Periodic=False, KnotStyle=1)  # -> Curve, Length, Domain
loft = Loft(
    Curves=flatten(intcrv_2.Curve),
    Options={Adjust=False, Closed=True, LoftEnds=0, LoftSimp=0, LoftType=0, Rebuild=10, Refit=0.01})
L = ClusterOutput(loft)

# ==== cluster AdjustCurveEnd
crv = ClusterInput()
crv_2 = ClusterInput()
crv_3 = Curve(simplify(crv))
crv_4 = Curve(crv_2)
end = EndPoints(Curve=crv_4)  # -> simplify(Start), End
lng = ListLength(List=crv_3)
dup = DuplicateData(Data=end.Start, Number=lng, Order=True)
crv_cp = CurveClosestPoint(Point=simplify(dup), Curve=crv_3)  # -> Point, Parameter, Distance
shatter = Shatter(Curve=graft(crv_3), Parameters=graft(crv_cp.Parameter))  # -> simplify(Segments)
trim = TrimTree(Tree=shatter, Depth=1)
python = GhPythonScript(x=crv_3, y=shatter, z=trim)  # -> out, a; inputs x: tree, y: tree, z: tree
# ---------- python: Python ----------
__author__ = "m0rya"

import rhinoscriptsyntax as rs

if len(x.Branch(0)) > 1:
    a = z
else:
    a = y
# ---------- end python ----------
a = ClusterOutput(python.a)

# ==== cluster Bottom_2
data = ClusterInput()
crv = ClusterInput()
data_2 = Data(data)
crv_2 = Curve(crv)
bang = ExplodeTree(Data=data_2)  # -> Branch0, graft(Branch1), Branch2, Branch3, Branch4
not = GateNot(A=bang.Branch3)
num = Number(bang.Branch0)
python = GhPythonScript(x=not, y=crv_2)  # -> out, a
# ---------- python: Python ----------
__author__ = "m0rya"

import rhinoscriptsyntax as rs

if x:
    a = y
# ---------- end python ----------
bang_2 = ExplodeTree(Data=bang.Branch1)  # -> Branch0, Branch1
python_2 = GhPythonScript(x=bang.Branch3, y=crv_2)  # -> out, a; same code as python
crv_3 = ClusterInput()
python_3 = GhPythonScript(x=bang.Branch4, y=crv_2)  # -> out, a; same code as python
num_2 = ClusterInput()
cluster = Cluster_7(data=python_3.a, num=num, pln=bang.Branch2, crv=crv_3)
bottom = Bottom(x=python.a, y=num, num=num_2)
uzumaki = Uzumaki(x=python_2.a, y=num, num=bang_2.Branch1)
python_4 = GhPythonScript(x=bottom, y=uzumaki, z=cluster, tgl_uzu=bang.Branch3, tgl_omori=bang.Branch4)  # -> out, a, b; inputs x: tree, y: tree, z: tree
# ---------- python_4: Python ----------
__author__ = "m0rya"

import rhinoscriptsyntax as rs

if tgl_uzu:
    a = y
else:
    a = x
    

if tgl_omori:
    b = z
else:
    b = None
# ---------- end python_4 ----------
merge = Merge(Data1=python_4.a, Data2=python_4.b)
R = ClusterOutput(merge)

# ==== cluster Alt_Protrusion5
data = ClusterInput()
data_2 = Data(data)
panel = Panel("""bottomlen
toplen
pitch

noise

crvs

data""")
bang = ExplodeTree(Data=data_2)  # -> Branch0, Branch1, Branch2, Branch3
graft = GraftTree(Tree=bang.Branch0, IncludeEmptyLists=True, IncludeNullItems=True)  # -> simplify(Tree)
bang_2 = ExplodeTree(Data=graft)  # -> Branch0, Branch1, Branch2
noise = Data(bang.Branch1)
slice_param = Data(bang.Branch3)
crv = Curve(graft(bang.Branch2))
adjust_crv_end = AdjustCrvEnd(crv=crv)
nurb2poly = NUrb2Poly(crv=adjust_crv_end, B=Slider(1, range=0..1))
split_curve_with_noise = SplitCurveWithNoise(data=bang_2.Branch2, crv=nurb2poly, data_3=noise)  # -> i, L, crv_3
line = Line(split_curve_with_noise.L)
crv_2 = Curve(split_curve_with_noise.crv_3)
crv_3 = Curve(split_curve_with_noise.i)
crv_4 = Curve(split_curve_with_noise.crv_3)
data_3 = Data(bang_2.Branch0)
data_4 = Data(bang_2.Branch1)
len = Length(Curve=crv_4)
crv_5 = Curve(split_curve_with_noise.L)
dom = ConstructDomain(DomainStart=data_4, DomainEnd=data_3)
bnd = Bounds(Numbers=len)
end = EndPoints(Curve=crv_5)  # -> simplify(Start), simplify(End)
remap = RemapNumbers(Value=len, Source=bnd, Target=dom)  # -> graft(Mapped), Clipped
area = Area(Geometry=split_curve_with_noise.i)  # -> Area, Centroid
addition = Addition(A=end.Start, B=end.End)
pt = Point(area.Centroid)
neg = Negative(Value=remap.Mapped)
division = Division(A=addition, B=2)  # -> simplify(Result)
data_5 = Data(simplify(neg))
cluster = Cluster_8(crv=crv_5, B=data_5)  # -> a, pl
data_6 = Data(graft(slice_param))
crv_6 = Curve(cluster.pl)
crv_7 = Curve(cluster.a)
data_7 = Data(data_6)
bang_3 = ExplodeTree(Data=data_7)  # -> Branch0, Branch1, Branch2
crv_8 = ClusterOutput(crv_7)
crv_9 = Curve(simplify(crv_6))
crv_10 = Curve(simplify(crv_7))
data_8 = Data(bang_3.Branch2)
data_9 = Data(bang_3.Branch1)
subtraction = Subtraction(A=data_8, B=1)
python = GhPythonScript(x=data_9, y=subtraction)  # -> out, a
# ---------- python: Python ----------
__author__ = "m0rya"

import rhinoscriptsyntax as rs

result = []

result.append(x*0.5)

for i in range(y-1):
    result.append(result[i] + x)
    
a = result
# ---------- end python ----------
python_2 = GhPythonScript(x=crv_9)  # -> out, a; inputs x: tree; same code as python_2
neg_2 = Negative(Value=python.a)
dup = DuplicateData(Data=neg_2, Number=python_2.a, Order=True)
lng = ListLength(List=neg_2)
partition = PartitionList(List=dup, Size=lng)  # -> simplify(Chunks)
offsetcrv = OffsetCrv2(relay=crv_9, B=2, num=partition)  # -> simplify(a)
a = ClusterOutput(offsetcrv)

# ==== cluster Alt_Protrusion_Koch
data = ClusterInput()
data_2 = Data(data)
panel = Panel("""bottomlen
toplen
pitch

noise

crvs

data""")
bang = ExplodeTree(Data=data_2)  # -> Branch0, Branch1, Branch2, Branch3
graft = GraftTree(Tree=bang.Branch0, IncludeEmptyLists=True, IncludeNullItems=True)  # -> simplify(Tree)
bang_2 = ExplodeTree(Data=graft)  # -> Branch0, Branch1, Branch2
noise = Data(bang.Branch1)
slice_param = Data(bang.Branch3)
crv = Curve(graft(bang.Branch2))
adjust_crv_end = AdjustCrvEnd(crv=crv)
nurb2poly = NUrb2Poly(crv=adjust_crv_end, B=Slider(1, range=0..1))
split_curve_with_noise = SplitCurveWithNoise(data=bang_2.Branch2, crv=nurb2poly, data_3=noise)  # -> i, L, crv_3
line = Line(split_curve_with_noise.L)
crv_2 = Curve(split_curve_with_noise.crv_3)
crv_3 = Curve(split_curve_with_noise.i)
crv_4 = Curve(split_curve_with_noise.crv_3)
data_3 = Data(bang_2.Branch0)
data_4 = Data(bang_2.Branch1)
len = Length(Curve=crv_4)
crv_5 = Curve(split_curve_with_noise.L)
dom = ConstructDomain(DomainStart=data_4, DomainEnd=data_3)
bnd = Bounds(Numbers=len)
end = EndPoints(Curve=crv_5)  # -> simplify(Start), simplify(End)
remap = RemapNumbers(Value=len, Source=bnd, Target=dom)  # -> graft(Mapped), Clipped
area = Area(Geometry=split_curve_with_noise.i)  # -> Area, Centroid
addition = Addition(A=end.Start, B=end.End)
pt = Point(area.Centroid)
neg = Negative(Value=remap.Mapped)
division = Division(A=addition, B=2)  # -> simplify(Result)
data_5 = Data(simplify(neg))
crv_6 = Curve(crv_5)
build_koch = Build_Koch(crv=crv_5, B=data_5)  # -> C, pl
data_6 = Data(graft(slice_param))
crv_7 = Curve(build_koch.pl)
crv_8 = Curve(build_koch.C)
data_7 = Data(data_6)
bang_3 = ExplodeTree(Data=data_7)  # -> Branch0, Branch1, Branch2
crv_9 = ClusterOutput(crv_8)
crv_10 = Curve(simplify(crv_7))
crv_11 = Curve(simplify(crv_8))
data_8 = Data(bang_3.Branch2)
data_9 = Data(bang_3.Branch1)
subtraction = Subtraction(A=data_8, B=1)
python = GhPythonScript(x=data_9, y=subtraction)  # -> out, a; same code as python
python_2 = GhPythonScript(x=crv_10)  # -> out, a; inputs x: tree; same code as python_2
neg_2 = Negative(Value=python.a)
dup = DuplicateData(Data=neg_2, Number=python_2.a, Order=True)
lng = ListLength(List=neg_2)
partition = PartitionList(List=dup, Size=lng)  # -> simplify(Chunks)
offsetcrv = OffsetCrv2(relay=crv_10, B=2, num=partition)  # -> simplify(a)
a = ClusterOutput(offsetcrv)

# ==== cluster Cluster
relay = ClusterInput()
len = Length(Curve=relay)
B = ClusterInput()
division = Division(A=len, B=B)
int = Integer(division)
divide = DivideCurve(Curve=relay, Count=int, Kinks=False)  # -> simplify(Points), Tangents, Parameters
num = ClusterInput()
relay_2 = ClusterInput()
num_2 = Number(num)
clean = CleanTree(RemoveNulls=True, RemoveInvalid=True, RemoveEmpty=True, Tree=divide.Tangents)
relay_3 = ClusterInput()
rotate = Rotate(Geometry=clean, Angle=1.570796327, Plane=PlaneXY(0, 0, 0))  # -> Geometry, Transform
clean_2 = CleanTree(RemoveNulls=True, RemoveInvalid=True, RemoveEmpty=True, Tree=divide.Points)
division_2 = Division(A=relay_2, B=num_2)
series = Series(Start=0, Step=division_2, Count=relay_3)
python = GhPythonScript(x=clean_2, y=rotate.Geometry, z=series)  # -> out, a; inputs x: tree of Point3d, y: tree of Point3d, z: list
# ---------- python: Python ----------
__author__ = "m0rya"

import rhinoscriptsyntax as rs
import ghpythonlib.treehelpers as th

result = []

for i in range(x.BranchCount):
    
    layer_crvs = []
    
    for j in range(len(z)):
        
        tmp = []
        for k in range(len(x.Branch(i))):
            
            tmp.append(x.Branch(i)[k] + y.Branch(i)[k] * z[j])
        
        tmp.append(tmp[0])
        layer_crvs.append(rs.AddInterpCurve(tmp))
    
    result.append(layer_crvs)
    

a = th.list_to_tree(result, source=[0,0])
# ---------- end python ----------
a = ClusterOutput(python.a)

# ==== cluster Cluster_4
crv = ClusterInput()
crv_2 = Curve(crv)
B = ClusterInput()
len = Length(Curve=crv_2)
division = Division(A=len, B=B)
int = Integer(division)
divide = DivideCurve(Curve=crv_2, Count=int, Kinks=False)  # -> Points, Tangents, Parameters
pline = PolyLine(Vertices=divide.Points, Closed=False)
trim = TrimTree(Tree=pline, Depth=1)
T = ClusterOutput(trim)

# ==== cluster Bottom
x = ClusterInput()
y = ClusterInput()
python = GhPythonScript(x=x, y=y)  # -> out, a, b; inputs x: tree
# ---------- python: Python ----------
__author__ = "m0rya"

import rhinoscriptsyntax as rs
import ghpythonlib.treehelpers as th

result = []
result2 = []

for i in range(x.BranchCount):
    
    if i < y:
        
        result.append([x.Branch(i)[len(x.Branch(i))-2]])
        result2.append([])
    else:
        result.append([])
        result2.append(x.Branch(i))
        
a = th.list_to_tree(result, source=[0])
b = th.list_to_tree(result2, source=[0])
# ---------- end python ----------
area = Area(Geometry=python.a)  # -> Area, simplify(Centroid)
num = ClusterInput()
eval = EvaluateCurve(Curve=python.a, Parameter=0)  # -> simplify(Point), Tangent, Angle
num_2 = Number(num)
dist = Distance(PointA=area.Centroid, PointB=eval.Point)
crv = Curve(python.a)
division = Division(A=dist, B=num_2)
int = Integer(division)
series = Series(Start=0, Step=num_2, Count=int)
neg = Negative(Value=series)  # -> simplify(Result)
offset = OffsetCurve(Curve=simplify(crv), Distance=neg, Plane=PlaneXY(0, 0, 0), Corners=1)
trim = TrimTree(Tree=offset, Depth=1)
crv_2 = Curve(python.b)
merge = Merge(Data1=simplify(crv_2), Data2=trim)
R = ClusterOutput(merge)

# ==== cluster Cluster_7
data = ClusterInput()
number_slider = Slider(2, range=0..10)
data_2 = Data(data)
bang = ExplodeTree(Data=data_2)  # -> Branch0, Branch1, Branch2
addition = Addition(A=Slider(20, range=0..100), B=number_slider)
addition_2 = Addition(A=Slider(22, range=0..100), B=number_slider)
addition_3 = Addition(A=Slider(15, range=0..100), B=number_slider)
num = ClusterInput()
Z = UnitZ(Factor=addition_3)
cir = Circle(Plane=PlaneXY(0, 0, 0), Radius=addition_2)
num_2 = Number(bang.Branch0)
num_3 = Number(bang.Branch1)
num_4 = Number(num)
move = Move(Geometry=cir, Motion=Z)  # -> Geometry, Transform
cir_2 = Circle(Plane=PlaneXY(0, 0, 0), Radius=addition)
loft = Loft(
    Curves=[cir_2, move.Geometry],
    Options={Adjust=False, Closed=False, LoftEnds=0, LoftSimp=0, LoftType=0, Rebuild=10, Refit=0.01})
multiplication = Multiplication(A=num_4, B=num_2)
Z_2 = UnitZ(Factor=multiplication)
num_5 = Number(num_3)
pln = ClusterInput()
move_2 = Move(Geometry=loft, Motion=Z_2)  # -> Geometry, Transform
pln_2 = Plane(pln)
num_6 = Number(num_5)
sec = BrepPlane(Brep=move_2.Geometry, Plane=pln_2)  # -> simplify(Curves), Points
num_7 = Number(num_5)
neg = Negative(Value=num_6)
series = Series(Start=0, Step=num_7, Count=Slider(3, range=0..10))
series_2 = Series(Start=0, Step=neg, Count=Slider(3, range=0..10))
offset = OffsetCurve(Curve=sec.Curves, Distance=series, Plane=PlaneXY(0, 0, 0), Corners=1)  # -> simplify(Curve)
offset_2 = OffsetCurve(Curve=sec.Curves, Distance=series_2, Plane=PlaneXY(0, 0, 0), Corners=1)  # -> simplify(Curve)
trim = TrimTree(Tree=offset_2, Depth=1)
trim_2 = TrimTree(Tree=offset, Depth=1)
item = ListItem(List=trim_2, Index=0, Wrap=True)
item_2 = ListItem(List=trim_2, Index=1, Wrap=True)
len = Length(Curve=item)
len_2 = Length(Curve=item_2)
crv = ClusterInput()
smaller = SmallerThan(FirstNumber=len, SecondNumber=len_2)  # -> SmallerThan, OrEqualTo
python = GhPythonScript(x=smaller.SmallerThan, y=trim_2, z=trim)  # -> out, a; inputs x: tree, y: tree, z: tree
# ---------- python: Python ----------
__author__ = "m0rya"

import rhinoscriptsyntax as rs
import ghpythonlib.treehelpers as th

result = []

for i in range(x.BranchCount):
    
    if x.Branch(i)[0]:
        result.append(y.Branch(i))
    else:
        result.append(z.Branch(i))
        
a = th.list_to_tree(result, source=[0])
# ---------- end python ----------
crv_2 = Curve(crv)
crv_3 = Curve(simplify(python.a))
branch = TreeBranch(Tree=crv_2, Path=Slider(0, range=0..100), MaintainPaths=True)
item_3 = ListItem(List=branch, Index=0, Wrap=True)
area = Area(Geometry=item_3)  # -> Area, Centroid
move_3 = Move(Geometry=crv_3, Motion=area.Centroid)  # -> Geometry, Transform
G = ClusterOutput(move_3.Geometry)

# ==== cluster Uzumaki
x = ClusterInput()
y = ClusterInput()
python = GhPythonScript(x=x, y=y)  # -> out, a, b; inputs x: tree
# ---------- python: Python ----------
__author__ = "m0rya"

import rhinoscriptsyntax as rs
import ghpythonlib.treehelpers as th

result = []
result2 = []

for i in range(x.BranchCount):
    
    if i < y:
        
        result.append([x.Branch(i)[0]])
        result2.append([])
    else:
        result.append([])
        result2.append(x.Branch(i))
        
a = th.list_to_tree(result, source=[0])
b = th.list_to_tree(result2, source=[0])
# ---------- end python ----------
len = Length()
crv = Curve(simplify(python.a))
num = ClusterInput()
num_2 = Number(num)
tweencurves = TweenCurves(T=crv, num=num_2)
infill = Infill(crv=crv, relay=num_2)
crv_2 = Curve(tweencurves)
num_3 = Number(num_2)
item = ListItem(List=crv_2, Index=-1, Wrap=True)
python_2 = GhPythonScript(x=item, y=num_3, z=crv_2)  # -> out, a; inputs z: list
# ---------- python_2: Python ----------
__author__ = "m0rya"

import rhinoscriptsyntax as rs


for i in range(9):
    
    offset = rs.OffsetCurve(x, rs.CurveAreaCentroid(x)[0], y*(1.0-i/10))


    if offset is not None:
        tmp = []
        tmp.extend(z)
        tmp.extend(offset)
        a = tmp
        break
        
else:
    a = z
# ---------- end python_2 ----------
build_uzumaki = BuildUzumaki(crv=python_2.a)
python_3 = GhPythonScript(x=infill, y=build_uzumaki)  # -> out, simplify(a); inputs x: tree, y: tree
# ---------- python_3: Python ----------
__author__ = "m0rya"

import rhinoscriptsyntax as rs

import ghpythonlib.treehelpers as th

result = []

for i in range(x.BranchCount):
    
    if i == 0:
        result.append(y.Branch(0))
    else:
        result.append(x.Branch(i))
        
a = th.list_to_tree(result, source=[0,0])
# ---------- end python_3 ----------
crv_3 = Curve(python.b)
merge = Merge(Data1=simplify(crv_3), Data2=python_3.a)
R = ClusterOutput(merge)

# ==== cluster AdjustCrvEnd
crv = ClusterInput()
crv_2 = Curve(crv)
item = ListItem(List=flatten(crv_2), Index=0, Wrap=True)
area = Area(Geometry=item)  # -> Area, Centroid
area_2 = Area(Geometry=crv_2)  # -> Area, Centroid
pdecon = Deconstruct(Point=area.Centroid)  # -> XComponent, YComponent, ZComponent
pdecon_2 = Deconstruct(Point=area_2.Centroid)  # -> XComponent, YComponent, ZComponent
vec = VectorXYZ(XComponent=pdecon.XComponent, YComponent=pdecon.YComponent, ZComponent=pdecon_2.ZComponent)  # -> Vector, Length
vec_2 = VectorXYZ(XComponent=0, YComponent=0, ZComponent=pdecon_2.ZComponent)  # -> Vector, Length
ln = Line(StartPoint=vec.Vector, EndPoint=vec_2.Vector)
ccx = CurveCurve(CurveA=crv_2, CurveB=ln)  # -> Points, ParamsA, ParamsB
shatter = Shatter(Curve=crv_2, Parameters=ccx.ParamsA)
S = ClusterOutput(shatter)

# ==== cluster NUrb2Poly
crv = ClusterInput()
crv_2 = Curve(crv)
len = Length(Curve=crv_2)
B = ClusterInput()
division = Division(A=len, B=B)
divide = DivideCurve(Curve=crv_2, Count=division, Kinks=False)  # -> Points, Tangents, Parameters
pline = PolyLine(Vertices=divide.Points, Closed=True)
pl = ClusterOutput(pline)

# ==== cluster SplitCurveWithNoise
crv = ClusterInput()
crv_2 = Curve(flatten(crv))
crv_3 = ClusterOutput(crv_2)
len = Length(Curve=crv_2)
dom = ConstructDomain(DomainStart=0, DomainEnd=len)
crvdom = CurveDomain(Curve=crv_2, Domain=dom)  # -> Curve, Domain
crv_4 = Curve(crvdom.Curve)
len_2 = Length(Curve=crv_4)
sort = SortList(Keys=len_2, ValuesA=crv_4)  # -> Keys, ValuesA
item = ListItem(List=sort.ValuesA, Index=-1, Wrap=True)
data = ClusterInput()
i = ClusterOutput(item)
len_3 = Length(Curve=item)
data_2 = Data(data)
division = Division(A=len_3, B=data_2)
data_3 = ClusterInput()
python = GhPythonScript(x=division)  # -> out, a; same code as python
data_4 = Data(data_3)
divide = DivideCurve(Curve=crv_4, Count=python.a, Kinks=False)  # -> Points, Tangents, simplify(Parameters)
num = Number(Slider(0.1, range=0.1..5))
python_2 = GhPythonScript(x=divide.Parameters, y=num, z=len, u=data_4)  # -> out, graft(a); inputs x: tree, z: list, u: list
# ---------- python_2: Python ----------
__author__ = "m0rya"

import rhinoscriptsyntax as rs
import ghpythonlib.treehelpers as th

result = []

num = x.BranchCount
adder = []

for i in range(num):
    adder.append(i*y)

adder = u
for i in range(x.BranchCount):
    
    tmp = []
    for j in range(len(x.Branch(i))):
        
        tmpNum = x.Branch(i)[j] + adder[i]
        
        if tmpNum > z[i]:
            tmp.append(tmpNum - z[i])
        elif tmpNum < 0:
            tmp.append(z[i] + tmpNum)
        else:
            tmp.append(tmpNum)
        

            
    result.append(tmp)
            
        
a = th.list_to_tree(result, source=[0])
# ---------- end python_2 ----------
trim = TrimTree(Tree=python_2.a, Depth=1)  # -> simplify(Tree)
eval = EvaluateCurve(Curve=graft(crv_4), Parameter=trim)  # -> Point, Tangent, Angle
shift = ShiftList(List=eval.Point, Shift=1, Wrap=True)
ln = Line(StartPoint=eval.Point, EndPoint=shift)  # -> simplify(Line)
L = ClusterOutput(ln)

# ==== cluster OffsetCrv2
relay = ClusterInput()
len = Length(Curve=relay)
B = ClusterInput()
division = Division(A=len, B=B)
int = Integer(division)
divide = DivideCurve(Curve=relay, Count=int, Kinks=False)  # -> simplify(Points), Tangents, Parameters
clean = CleanTree(RemoveNulls=True, RemoveInvalid=True, RemoveEmpty=True, Tree=divide.Tangents)
num = ClusterInput()
rotate = Rotate(Geometry=clean, Angle=1.570796327, Plane=PlaneXY(0, 0, 0))  # -> Geometry, Transform
clean_2 = CleanTree(RemoveNulls=True, RemoveInvalid=True, RemoveEmpty=True, Tree=divide.Points)
num_2 = Number(num)
python = GhPythonScript(x=clean_2, y=rotate.Geometry, z=num_2)  # -> out, a; inputs x: tree of Point3d, y: tree of Point3d, z: tree
# ---------- python: Python ----------
__author__ = "m0rya"

import rhinoscriptsyntax as rs
import ghpythonlib.treehelpers as th

result = []

for i in range(x.BranchCount):
    
    layer_crvs = []
    
    for j in range(len(z.Branch(i))):
        
        tmp = []
        for k in range(len(x.Branch(i))):
            
            tmp.append(x.Branch(i)[k] + y.Branch(i)[k] * z.Branch(i)[j])
        
        tmp.append(tmp[0])
        layer_crvs.append(rs.AddInterpCurve(tmp))
    
    result.append(layer_crvs)
    

a = th.list_to_tree(result, source=[0,0])
# ---------- end python ----------
a = ClusterOutput(python.a)

# ==== cluster Cluster_8
crv = ClusterInput()
crv_2 = Curve(crv)
end = EndPoints(Curve=crv_2)  # -> Start, End
midpt = CurveMiddle(Curve=crv_2)
subtraction = Subtraction(A=end.End, B=end.Start)
rad = Radians(Degrees="-90")
rotate = Rotate(Geometry=subtraction, Angle=rad, Plane=PlaneXY(0, 0, 0))  # -> Geometry, Transform
unit = UnitVector(Vector=rotate.Geometry)
B = ClusterInput()
multiplication = Multiplication(A=unit, B=B)
move = Move(Geometry=end.Start, Motion=multiplication)  # -> Geometry, Transform
pline = PolyLine(Vertices=move.Geometry, Closed=True)
python = GhPythonScript(x=move.Geometry, y=midpt)  # -> out, simplify(a); inputs x: tree, y: tree
# ---------- python: Python ----------
__author__ = "m0rya"

import rhinoscriptsyntax as rs
import ghpythonlib.treehelpers as th

result = []

for i in range(x.BranchCount):
    
    tmp = []
    for j in range(len(x.Branch(i))):
        
        tmp.append(x.Branch(i)[j])
        if j%2 == 0:
            
            tmp.append(y.Branch(i)[j])
     
    else:
        tmp.append(tmp[0])
        
    result.append([rs.AddPolyline(tmp)])
    
a = th.list_to_tree(result, source=[0])
# ---------- end python ----------
pl = ClusterOutput(pline)
a = ClusterOutput(python.a)

# ==== cluster Build_Koch
crv = ClusterInput()
crv_2 = Curve(crv)
end = EndPoints(Curve=crv_2)  # -> Start, End
midpt = CurveMiddle(Curve=crv_2)
subtraction = Subtraction(A=end.End, B=end.Start)
rad = Radians(Degrees="-90")
rotate = Rotate(Geometry=subtraction, Angle=rad, Plane=PlaneXY(0, 0, 0))  # -> Geometry, Transform
unit = UnitVector(Vector=rotate.Geometry)
B = ClusterInput()
multiplication = Multiplication(A=unit, B=B)
move = Move(Geometry=end.Start, Motion=multiplication)  # -> Geometry, Transform
python = GhPythonScript(x=move.Geometry, y=midpt)  # -> out, simplify(a), b, c; inputs x: tree, y: tree
# ---------- python: Python ----------
__author__ = "m0rya"

import rhinoscriptsyntax as rs
import ghpythonlib.treehelpers as th

result = []
result2 = []
result3 = []

for i in range(x.BranchCount):
    
    tmp = []
    tmp2 = []
    for j in range(len(x.Branch(i))-1):
        
        if j%2 == 0:
            tmp2.append(rs.AddLine(x.Branch(i)[j], y.Branch(i)[j]))
            tmp2.append(rs.AddLine(y.Branch(i)[j], x.Branch(i)[j+1]))
            
        else:
            tmp.append(rs.AddLine(x.Branch(i)[j], x.Branch(i)[j+1]))
    
    tmp.append(rs.AddLine(x.Branch(i)[len(x.Branch(i))-1], x.Branch(i)[0]))
    '''
    else:
         continue
        #tmp.append(rs.AddLine(x.Branch(i)[j], x.Branch(i)[0]))
    '''
        
        
    #result.append([rs.AddPolyline(tmp)])
    result2.append(tmp2)
    result3.append(tmp)
    
a = th.list_to_tree(result, source=[0])
b = th.list_to_tree(result2, source=[0,0])
c = th.list_to_tree(result3, source=[0,0])
# ---------- end python ----------
pline = PolyLine(Vertices=move.Geometry, Closed=True)
pl = ClusterOutput(pline)
crv_3 = Curve(simplify(python.b))
crv_4 = Curve(simplify(python.c))
number_slider = Slider(10, range=0..10)
X = UnitX(Factor=1)
vec = VectorXYZ(XComponent=0, YComponent=0, ZComponent=0)  # -> Vector, Length
line = LineSDL(Start=vec.Vector, Direction=X, Length=number_slider)
python_2 = GhPythonScript(x=line)  # -> out, a; inputs x: list
# ---------- python_2: Python ----------
__author__ = "m0rya"

import rhinoscriptsyntax as rs


def koch(crv, num):
    
    if num == 0:
        return crv
        
    else:
        num -= 1
        
        
        nextCrv = []
        for i in range(len(crv)):
            start = rs.CurveStartPoint(crv[i])
            end = rs.CurveEndPoint(crv[i])
            
            #pnt1 = (start+end)/3
            pnt1 = start/3 + end*2/3
            pnt2 = start*2/3 + end/3
            #pnt2 = (start+end)/3*2
            mid = (start+end)/2
            
            vec = rs.VectorUnitize(end - start)
            vec = rs.VectorRotate(vec, -90, (0,0,1))
            
            pnt3 = mid + vec * rs.CurveLength(crv[i]) * 0.2
            
            nextCrv.append(rs.AddLine(start, pnt2))
            nextCrv.append(rs.AddLine(pnt2, pnt3))
            nextCrv.append(rs.AddLine(pnt3, pnt1))
            nextCrv.append(rs.AddLine(pnt1, end))
            
            
        
        return koch(nextCrv, num)
        
      
a = koch(x, 2)
# ---------- end python_2 ----------
crv_5 = Curve(crv_3)
join = JoinCurves(Curves=python_2.a, Preserve=False)
len = Length(Curve=crv_5)
end_2 = EndPoints(Curve=crv_5)  # -> Start, End
end_3 = EndPoints(Curve=line)  # -> Start, End
division = Division(A=len, B=number_slider)
scale = Scale(Geometry=join, Center=Point(0, 0, 0), Factor=division)  # -> Geometry, Transform
Y = UnitY(Factor=1)
X_2 = UnitX(Factor=1)
subtraction_2 = Subtraction(A=end_2.End, B=end_2.Start)
angle = Angle(VectorA=subtraction_2, VectorB=Y)  # -> Angle, Reflex
angle_2 = Angle(VectorA=subtraction_2, VectorB=X_2)  # -> Angle, Reflex
deg = Degrees(Radians=angle.Angle)
python_3 = GhPythonScript(x=deg, y=angle_2.Angle)  # -> out, a
# ---------- python_3: Python ----------
__author__ = "m0rya"

import rhinoscriptsyntax as rs


if x > 90:
    a = -1 * y
else:
    a = y
# ---------- end python_3 ----------
rotate_2 = Rotate(Geometry=scale.Geometry, Angle=python_3.a, Plane=PlaneXY(0, 0, 0))  # -> Geometry, Transform
move_2 = Move(Geometry=rotate_2.Geometry, Motion=end_2.Start)  # -> Geometry, Transform
merge = Merge(Data1=crv_4, Data2=simplify(move_2.Geometry))
join_2 = JoinCurves(Curves=merge, Preserve=False)  # -> simplify(Curves)
C = ClusterOutput(join_2)

# ==== cluster TweenCurves
T = ClusterInput()
branch = TreeBranch(Tree=T, Path="{0}", MaintainPaths=True)
brec = BoundingRectangle(Geometry=branch, Plane=PlaneXY(0, 0, 0), Axis=0, Slide=0, Union=True)
debox = DeconstructBox(Box=brec)  # -> Plane, X, Y, Z
num = ClusterInput()
int = Integer(debox.X)
int_2 = Integer(debox.Y)
merge = Merge(Data1=int, Data2=int_2)
num_2 = Number(num)
sort = SortList(Keys=merge)  # -> Keys, ValuesA
item = ListItem(List=sort.Keys, Index=-1, Wrap=True)
multiplication = Multiplication(A=num_2, B=2)
area = Area(Geometry=branch)  # -> Area, Centroid
len = Length(Curve=branch)
division = Division(A=multiplication, B=item)
scale = Scale(Geometry=branch, Center=area.Centroid, Factor=division)  # -> Geometry, Transform
divide = DivideCurve(Curve=branch, Count=len, Kinks=False)  # -> Points, Tangents, Parameters
lng = ListLength(List=divide.Points)
divide_2 = DivideCurve(Curve=scale.Geometry, Count=len, Kinks=False)  # -> Points, Tangents, Parameters
series = Series(Start=0, Step=1, Count=lng)
dist = Distance(PointA=divide.Points, PointB=area.Centroid)
sort_2 = SortList(Keys=dist, ValuesA=series)  # -> Keys, ValuesA
item_2 = ListItem(List=sort_2.ValuesA, Index=-1, Wrap=True)
item_3 = ListItem(List=divide.Points, Index=item_2, Wrap=True)
item_4 = ListItem(List=divide_2.Points, Index=item_2, Wrap=True)
dist_2 = Distance(PointA=item_3, PointB=item_4)
num_3 = Number(num_2)
division_2 = Division(A=dist_2, B=num_3)
subtraction = Subtraction(A=division_2, B=1)
division_3 = Division(A=Slider(1, range=0..1), B=subtraction)
series_2 = Series(Start=0, Step=division_3, Count=division_2)
twn2crvs = TweenTwoCurves(CurveA=branch, CurveB=scale.Geometry, Factor=series_2, Refit=0, PointSample=0)
crv = Curve(twn2crvs)
crv_2 = ClusterOutput(crv)

# ==== cluster BuildUzumaki
crv = ClusterInput()
crv_2 = Curve(crv)

number_slider = Slider(1, range=0..10)

crv_3 = Curve(crv_2)
item = ListItem(List=crv_3, Index=0, Wrap=True)

python = GhPythonScript(x=crv_2)  # -> out, a; inputs x: list
# ---------- python: Python ----------
__author__ = "m0rya"

import rhinoscriptsyntax as rs
import ghpythonlib.treehelpers as th


result = []

for i in range(len(x)-1):
    
    tmp = [x[i], x[i+1]]
    result.append(tmp)
    
a = th.list_to_tree(result, source=[0])
# ---------- end python ----------
item_2 = ListItem(List=python.a, Index=0, Wrap=True)
len = Length(Curve=item_2)
division = Division(A=len, B=Slider(0.1, range=0..0.1))
item_3 = ListItem(List=python.a, Index=1, Wrap=True)
divide = DivideCurve(Curve=item_2, Count=division, Kinks=False)  # -> Points, Tangents, Parameters
item_4 = ListItem(List=divide.Points, Index=0, Wrap=True)
ins = InsertItems(List=divide.Points, Item=item_4, Indices=-1, Wrap=True)
crv_cp = CurveClosestPoint(Point=ins, Curve=item_3)  # -> Point, Parameter, Distance
lng = ListLength(List=ins)
subtraction = Subtraction(A=lng, B=1)
subtraction_2 = Subtraction(A=crv_cp.Point, B=ins)
division_2 = Division(A=Slider(1, range=0..1), B=subtraction)
series = Series(Start=0, Step=division_2, Count=lng)
multiplication = Multiplication(A=subtraction_2, B=series)
addition = Addition(A=ins, B=multiplication)  # -> simplify(Result)
cull_i = CullIndex(List=addition, Indices=-1, Wrap=True)  # -> flatten(List)

python_2 = GhPythonScript(x=addition)  # -> out, a; inputs x: tree
# ---------- python_2: Python ----------
__author__ = "m0rya"

import rhinoscriptsyntax as rs

a = x.Branch(x.BranchCount-1)[len(x.Branch(x.BranchCount-1))-1]
# ---------- end python_2 ----------
merge = Merge(Data1=cull_i, Data2=python_2.a)

intcrv = Interpolate(Vertices=merge, Degree=3, Periodic=False, KnotStyle=1)  # -> Curve, Length, Domain
crv_4 = Curve(intcrv.Curve)

merge_2 = Merge(Data1=flatten(item), Data2=flatten(crv_4))  # -> flatten(Result)
R = ClusterOutput(merge_2)

# ==== cluster Infill
crv = ClusterInput()
crv_2 = Curve(crv)
item = ListItem(List=flatten(crv_2), Index=0, Wrap=True)
brec = BoundingRectangle(Geometry=item, Plane=PlaneXY(0, 0, 0), Axis=0, Slide=0, Union=True)
offset = OffsetCurve(Curve=brec, Distance=Slider(50, range=0..100), Plane=PlaneXY(0, 0, 0), Corners=1)
relay = ClusterInput()
cp = ControlPoints(Curve=offset)  # -> Points, Weights, Knots
item_2 = ListItem(List=cp.Points, Index=0, Wrap=True)
item_3 = ListItem(List=cp.Points, Index=2, Wrap=True)
multiplication = Multiplication(A=relay, B=Slider(0.8, range=0..1))
item_4 = ListItem(List=cp.Points, Index=1, Wrap=True)
item_5 = ListItem(List=cp.Points, Index=3, Wrap=True)
num = Number(multiplication)
subtraction = Subtraction(A=item_5, B=item_4)
ln = Line(StartPoint=item_2, EndPoint=item_3)
vlen = VectorLength(Vector=subtraction)
midpt = CurveMiddle(Curve=ln)
division = Division(A=vlen, B=num)
subtraction_2 = Subtraction(A=item_4, B=midpt)
int = Integer(division)
move = Move(Geometry=ln, Motion=subtraction_2)  # -> Geometry, Transform
unit = UnitVector(Vector=subtraction)
series = Series(Start=0, Step=num, Count=int)
multiplication_2 = Multiplication(A=unit, B=series)
crv_3 = Curve(crv_2)
move_2 = Move(Geometry=move.Geometry, Motion=multiplication_2)  # -> Geometry, Transform
area = Area(Geometry=crv_3)  # -> Area, Centroid
project = Project(Geometry=move_2.Geometry, Plane=area.Centroid)  # -> simplify(Geometry), Transform
crv_4 = Curve(project.Geometry)
pt = Point(area.Centroid)
python = GhPythonScript(x=crv_4, y=pt)  # -> out, simplify(a); inputs x: tree, y: tree
# ---------- python: Python ----------
__author__ = "m0rya"

import rhinoscriptsyntax as rs
import ghpythonlib.treehelpers as th


result = []

for i in range(x.BranchCount):
    
    if len(x.Branch(i)) != 0:
        
        if i%2 == 0:
            result.append(rs.RotateObjects(x.Branch(i), y.Branch(i)[0], 90))
            
        else:
            result.append(x.Branch(i))
            
    else:
        result.append([])

a = th.list_to_tree(result, source=[0])
# ---------- end python ----------
trim = TrimWithRegion(Curve=simplify(python.a), Region=simplify(crv_3))  # -> Inside, Outside
trim_2 = TrimTree(Tree=trim.Inside, Depth=1)
dispatch = Dispatch(List=trim_2, DispatchPattern=[True, False])  # -> ListA, ListB
flip = FlipCurve(Curve=dispatch.ListB)  # -> Curve, Flag
weave = Weave(Pattern=[0, 1], Stream0=dispatch.ListA, Stream1=flip.Curve, NullGaps=False)
shift = ShiftList(List=weave, Shift=1, Wrap=False)
short = ShortestList(ListA=weave, ListB=shift, TrimMode=2)  # -> ListA, ListB
end = EndPoints(Curve=short.ListB)  # -> Start, End
end_2 = EndPoints(Curve=short.ListA)  # -> Start, End
ln_2 = Line(StartPoint=end_2.End, EndPoint=end.Start)
weave_2 = Weave(Pattern=[0, 1], Stream0=weave, Stream1=ln_2, NullGaps=False)
join = JoinCurves(Curves=weave_2, Preserve=False)
crv_5 = Curve(join)
crv_6 = Curve(crv_3)
merge = Merge(Data1=crv_6, Data2=simplify(crv_5))
R = ClusterOutput(merge)
